# Grasshopper definition LAC_Samplefile.gh (Grasshopper 1.0.7)
# plug-ins: LCA_DEV

lac_construct_material_from_materialpyra = LACConstructMaterialFromMaterialpyramidenDk(menu=[dropdown(1), dropdown(2)])
# 01
# Construct and deconstruct materials
lac_construct_material_from_materialpyra_2 = LACConstructMaterialFromMaterialpyramidenDk(menu=[dropdown(1), dropdown(4)])
lca_material = LCAMaterial()  # -> Material, Name, Category, Description, Density_kg_m3, Insulation_W_m2_K, GWPKgCO2eqM3A1A3, ODP_R11_eq_m3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
lca_material_2 = LCAMaterial(Name="Super eco wood material", Density_kg_m3="450", GWPKgCO2eqM3A1A3="10", DataSource="My imagination")  # -> Material, Name, Category, Description, Density_kg_m3, Insulation_W_m2_K, GWPKgCO2eqM3A1A3, ODP_R11_eq_m3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
panel = Panel([lca_material.Material, lca_material.Name, lca_material.Category, lca_material.Description, lca_material.Density_kg_m3, lca_material.Insulation_W_m2_K, lca_material.GWPKgCO2eqM3A1A3, lca_material.ODP_R11_eq_m3, lca_material.POCP, lca_material.EP, lca_material.AP, lca_material.A4_CO2eq_kg, lca_material.C_CO2eq_kg, lca_material.D_CO2eq_kg, lca_material.DataSource, lca_material.MaterialGUID])
panel_2 = Panel(lac_construct_material_from_materialpyra)

# ----
# 02
# Combine geometry and materials into elements.
# 1m³ box
geometry = Geometry({Plane=PlaneXY(0, 0, 0), X=Domain(0, 1000), Y=Domain(0, 1000), Z=Domain(0, 1000)})

# ----
# 1m curve
curve = Curve(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)

# ----
# from a curve
panel_3 = Panel("200")
lca_create_element_from_curve = LCACreateElementFromCurve(
    Curve=curve,
    Material=lac_construct_material_from_materialpyra,
    CrossSectionArea_Rhino_Units_2=panel_3,
    ExpectedLifetime_years="50")  # -> Element, Volume_m3, Weight_kg, GWPA1A3_kg_CO2eq

# ----
# 1m² surface
surface = Surface(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)

# ----
# from a surface
panel_4 = Panel("10")
lca_create_element_from_surface = LCACreateElementFromSurface(Surface=surface, Material=lca_material_2.Material, Thickness_Rhino_Units_2=panel_4, ExpectedLifetime_years="100")  # -> Element, Volume_m3, Weight_kg, GWPA1A3_kg_CO2eq

# ----
# from a sold
lca_create_element_from_solid = LCACreateElementFromSolid(Geometry=geometry, Material=lac_construct_material_from_materialpyra, ExpectedLifetime_years="10", ElementGroup="Boxes")  # -> Element, Volume_m3, Weight_kg, GWP_kg_CO2eq

# ----
# 03
# assemble elements into a model
merge = Merge(
    Data1=lca_create_element_from_solid.Element,
    Data2=lca_create_element_from_curve.Element,
    Data3=lca_create_element_from_surface.Element)
lca_assemble_model = LCAAssembleModel(Elements=merge, CalculatedBuildingLifetime_years="10")  # -> Model, ListNamesByMaterial, SUMGWP_kg_CO2eq, ListGWPKgCO2eqByMaterial, ListGWPByMaterial, SUMWeight_kg, ListWeightKgByMaterial, ListWeightByMaterial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
panel_5 = Panel(lca_assemble_model.ListGWPByMaterial)
panel_6 = Panel(lca_assemble_model.ListGWPKgCO2eqByMaterial)

# ----
# 04
# ANALYSE AND FILTER MODEL
# 
# UNDER DEVELOMPENT
lca_results_by_element = LCAResultsByElement(Model=lca_assemble_model.Model)
