# Grasshopper definition DevDebug.gh (Grasshopper 1.0.7)
# plug-ins: LCA_Toolbox, CORE.Toolbox.Grasshopper, LunchBox

lac_get_material_from_materialpyramiden = LACGetMaterialFromMaterialpyramidenDk(dropvariable_category="trae", dropvariable_material="Oak tree", menu=[dropdown(4), dropdown(0)])
lac_get_material_from_materialpyramiden_2 = LACGetMaterialFromMaterialpyramidenDk(dropvariable_category="mineralsk", dropvariable_material="Concrete C20/25", menu=[dropdown(3), dropdown(0)])
lca_material = LCAMaterial(Material=lac_get_material_from_materialpyramiden_2, A1A3ProductStage_kg_CO2eq_m3="10")  # -> Material, MaterialName, Category, Description, Density_kg_m3, Insulation_W_m2_K, A1A3ProductStage_kg_CO2eq_m3, ODP_R11_eq_m3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
lca_material_2 = LCAMaterial(
    Material=lac_get_material_from_materialpyramiden,
    Density_kg_m3=Slider(1, range=0..1),
    A1A3ProductStage_kg_CO2eq_m3="100",
    C1C4EndOfLife_kg_CO2eq_m3="12")  # -> Material, MaterialName, Category, Description, Density_kg_m3, Insulation_W_m2_K, A1A3ProductStage_kg_CO2eq_m3, ODP_R11_eq_m3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
rectangle = Rectangle(Plane=PlaneXY(0, 0, 0), XSize="1000", YSize="1000", Radius=0)  # -> Rectangle, Length
box_rectangle = BoxRectangle(Rectangle=rectangle.Rectangle, Height="1000")
lca_element_from_solid = LCAElementFromSolid(
    SolidGeomerty=box_rectangle,
    Material=lca_material.Material,
    ExpectedLifetime_years=Slider(10, range=0..10),
    A4TransportationToSite_kg_CO2eq_kg=Slider(10, range=0..10),
    DReuseFactor=Slider(0.5, range=0..1))  # -> Element, Volume_m3, Weight_kg, A1A3ProductStage_kg_CO2eq_element
lca_element_from_solid_2 = LCAElementFromSolid(
    SolidGeomerty=box_rectangle,
    Material=lca_material_2.Material,
    ExpectedLifetime_years="11",
    A4TransportationToSite_kg_CO2eq_kg="3")  # -> Element, Volume_m3, Weight_kg, A1A3ProductStage_kg_CO2eq_element
lca_element_from_solid_3 = LCAElementFromSolid(SolidGeomerty=box_rectangle, Material=lca_material_2.Material, ExpectedLifetime_years="30")  # -> Element, Volume_m3, Weight_kg, A1A3ProductStage_kg_CO2eq_element
series = Series(Start=0, Step=1, Count=10)
number_slider = Slider(1, range=0..1000)
lca_assemble_model = LCAAssembleModel(
    Elements=lca_element_from_solid_2.Element,
    B6OperationalEnergy_kg_CO2eq_year=series,
    ExpectedLifetime_years=Slider(60, range=1..100))  # -> Model, GWPTotal_kg_CO2eq
lca_result_simple = LCAResultSimple(Model=lca_assemble_model.Model, AllowCarbonSequestration=Toggle(False))  # -> EmbodiedCarbon_kg_CO2eq, OperationalCarbon_kg_CO2eq, GWPTotal_kg_CO2eq
lca_result_timeline = LCAResultTimeline()
panel = Panel("""E
O
T""")
integer = Integer([lca_result_simple.EmbodiedCarbon_kg_CO2eq, lca_result_simple.OperationalCarbon_kg_CO2eq, lca_result_simple.GWPTotal_kg_CO2eq])
construct_attributes = ConstructAttributes(Keys=panel, Values=integer)
create_csv = CreateCSV(DataGridHeaders=panel, ValueTree=graft(integer), Delimiter=",")
write_to_excel = WriteToExcel(Attributes=construct_attributes, LocationAddress="A1", Stream=Toggle(True))
