# Grasshopper definition LCA SAMPLE.gh (Grasshopper 1.0.7)
# plug-ins: LCA_DEV

# ----
# 01 Material  to and from JSON (BETA)
lac_construct_material_from_materialpyra = LACConstructMaterialFromMaterialpyramidenDk(dropvariable_category="trae", dropvariable_material="Construction timber", menu=[dropdown(4), dropdown(8)])
material_to_json = MaterialToJSON(Material=lac_construct_material_from_materialpyra)
panel = Panel(material_to_json)
material_from_json = MaterialFromJSON(JSON=panel)
lca_material = LCAMaterial(Material=material_from_json)  # -> Material, MaterialName, Category, Description, Density_kg_m3, Insulation_W_m2_K, GWPKgCO2eqM3A1A3, ODP_R11_eq_m3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
panel_2 = Panel(lca_material.MaterialName)

# ----
# -Or create your own from scratch
panel_3 = Panel("MaterialPytamiden.dk")
lca_material_2 = LCAMaterial(MaterialName="XPS insulation", Category="kunststof", Density_kg_m3="32", GWPKgCO2eqM3A1A3="96.3", DataSource=panel_3)  # -> Material, MaterialName, Category, Description, Density_kg_m3, Insulation_W_m2_K, GWPKgCO2eqM3A1A3, ODP_R11_eq_m3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

# ----
# 01 Material:
# - Select from materialpyramiden.dk database
lac_construct_material_from_materialpyra_2 = LACConstructMaterialFromMaterialpyramidenDk(dropvariable_category="trae", dropvariable_material="Construction timber", menu=[dropdown(4), dropdown(8)])

# ----
# -Or modify
# the material component follows the "Pass-through Components" pattern
# https://www.rhino3d.com/docs/guides/grasshopper/object-attributes/
panel_4 = Panel("XPS insulation, alternative brand")
lca_material_3 = LCAMaterial(Material=lca_material_2.Material, MaterialName=panel_4, GWPKgCO2eqM3A1A3="150", A4_CO2eq_kg="12")  # -> Material, MaterialName, Category, Description, Density_kg_m3, Insulation_W_m2_K, GWPKgCO2eqM3A1A3, ODP_R11_eq_m3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
panel_5 = Panel(lca_material_3.MaterialName)
panel_6 = Panel(lca_material_3.Category)
panel_7 = Panel(lca_material_3.Density_kg_m3)
panel_8 = Panel(lca_material_3.GWPKgCO2eqM3A1A3)

# ----
# Expected lifetime, name and group
# Expected lifetime [years]
#  - This is the expected lifetime of this element before it has to be replaced.
#                At end of life ... D + new A1-4 a value
#                -1 means infinite life
# Name and group are used for filtering the results
number_slider = Slider(30, range=0..100)
lca_element_from_volume = LCAElementFromVolume(
    Material=lac_construct_material_from_materialpyra_2,
    Volume_m3="5",
    ExpectedLifetime_years=number_slider,
    ElementName="stud wall",
    ElementGroup="load bearing structure")  # -> Element, Weight_kg, GWPKgCO2eqM3A1A3

# ----
# From Shell
# Create elements from thin shells by specifying the thickness
# 
#  -shells can be brep or mesh
# -this component uses the surface area of the input , even for closed volumes.
test_geo_1x1m_untrimmed_surface = Geometry(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)
lca_element_from_shell = LCAElementFromShell(
    ShellGeomerty=test_geo_1x1m_untrimmed_surface,
    Material=lac_construct_material_from_materialpyra_2,
    Thickness_Rhino_Units=Slider(50, range=0..100),
    ExpectedLifetime_years=-1)  # -> Element, Volume_m3, Weight_kg, GWPKgCO2eqM3A1A3

# ----
# From Curve
# Create elements from curves by specifying the area of the cross sectional area
panel_9 = Panel("100*100")
# 02 Elements
# Combine materials with geometry to create Elements
test_geo_1000mm_line = Line(Line((0, 0, 0), (0, 0, 1000)))
number = Number(panel_9)
lca_element_from_curve = LCAElementFromCurve(
    Curve=test_geo_1000mm_line,
    Material=lac_construct_material_from_materialpyra_2,
    CrossSectionArea_Rhino_Units_2=number,
    ExpectedLifetime_years=-1)  # -> Element, Volume_m3, Weight_kg, GWPKgCO2eqM3A1A3

# ----
# From Solid
# Create elements from thin shells by specifying the thickness
# 
#  -shells can be brep or mesh
# -this component uses the surface area of the input , even for closed volumes.
test_geo_1x1x1m_closed_brep = Geometry(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)
lca_element_from_solid = LCAElementFromSolid(SolidGeomerty=test_geo_1x1x1m_closed_brep, Material=lca_material_2.Material, ExpectedLifetime_years=-1)  # -> Element, Volume_m3, Weight_kg, GWPKgCO2eqM3A1A3

# ----
# From Volum
# Create elements by specifying the volume directly
panel_10 = Panel("5")
lca_element_from_volume_2 = LCAElementFromVolume(Material=lca_material_3.Material, Volume_m3=panel_10, ExpectedLifetime_years=-1)  # -> Element, Weight_kg, GWPKgCO2eqM3A1A3

# ----
# 03 Model
# Combine elements into a model
merge = Merge(
    Data1=lca_element_from_curve.Element,
    Data2=lca_element_from_shell.Element,
    Data3=lca_element_from_solid.Element,
    Data4=lca_element_from_volume_2.Element,
    Data5=lca_element_from_volume.Element)
lca_assemble_model = LCAAssembleModel(Element=merge, CalculatedBuildingLifetime_years="60")  # -> Model, GWPKgCO2eqTotal

# ----
# 04 Results
# Or filter by name or category. Eather for material or element
# 
# Filter for select or cull are under development
panel_11 = Panel("load bearing structure")
# THIS PART IS UNDER DEVELOPMENT !
# Extract data from the model
lca_detailed_result = LCADetailedResult(Model=lca_assemble_model.Model)  # -> Model, ListNamesByMaterial, GWPKgCO2eqM3A1A3, ListGWPKgCO2eqByMaterial, ListGWPByMaterial, SUMWeight_kg, ListWeightKgByMaterial, ListWeightByMaterial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
lca_filter_model = LCAFilterModel(Model=lca_assemble_model.Model, ElementGroup=panel_11)
panel_12 = Panel(lca_detailed_result.ListNamesByMaterial)
lca_detailed_result_2 = LCADetailedResult(Model=lca_filter_model, AllowCarbonSequestration=Toggle(True))  # -> Model, ListNamesByMaterial, GWPKgCO2eqM3A1A3, ListGWPKgCO2eqByMaterial, ListGWPByMaterial, SUMWeight_kg, ListWeightKgByMaterial, ListWeightByMaterial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
panel_13 = Panel([lca_detailed_result_2.ListNamesByMaterial, lca_detailed_result_2.GWPKgCO2eqM3A1A3])
panel_14 = Panel(lca_detailed_result_2.SUMWeight_kg)

panel_15 = Panel(lca_detailed_result.SumA4Transportation_kg_CO2eq)
panel_16 = Panel(lca_detailed_result.SumA1A3ProductStage_kg_CO2eq)
panel_17 = Panel(lca_detailed_result.ListGWPKgCO2eqByMaterial)
